# Grasshopper definition 9_ML_Inference_Comfort.ghx (Grasshopper 1.0.8)
# plug-ins: Eddy3D

# ---- group: model selection
list = ValueList({"GAN": 0, "FNO": 1, "Transformer": 2}, selected="GAN")

# ---- group: FNO_ONXX file
path = FilePath("C:\Users\ilker\Desktop\FNO\hybrid_fno.onnx")

# ---- group: GAN- ONNX File
# How to?
# 
# -Please downlaod the ML models first (GAN and FNO).
#  Then assign them in the "File Path" components, respectively.
# 
# -Connect your input geometry to "Builidngs"
# 
# -Define wind speed/direction (optional).
# 
# -Define legend (optional).
path_2 = FilePath("C:\Users\ilker\Desktop\Conditional_Transformer\Pix2PixHD_Model\pix2pixhd_generator.onnx")

# ---- group: Transformer- ONNX File
path_3 = FilePath("C:\Users\ilker\Desktop\Conditional_Transformer\conditional_transformer.onnx")

# ----
entwine = Entwine(Branch00=path_2, Branch01=path, Branch02=path_3, FlattenInputs=True)  # -> simplify(Result)
branch = TreeBranch(Tree=entwine, Path=list, MaintainPaths=False)

# ---- group: Terrain- Do not change / TERRAIN
srf = Surface(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)

# ----
list_2 = ValueList({"Wind Comfort Study - 8 wind directions": 0, "Wind Comfort Study - 16 wind directions": 1}, selected="Wind Comfort Study - 8 wind directions")

# ---- group: Terrain- Do not change
move = Move(Geometry=srf, Motion=Vector(0, 0, 1.8))  # -> Geometry, Transform
brep2grid = BrepToGridPoints(Geometry=move.Geometry, Spacing="2", Run=True)  # -> Points, Status

# ---- group: Buildings
brep = Brep([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])

# ---- group: Wind Speed
panel = Panel("5")

# ----
range = Range(Domain="0 To 337.5", Steps=15)
range_2 = Range(Domain="0 To 315", Steps=7)
preview = CustomPreview(Geometry=brep, Material=ColourSwatch(SwatchColor=RGB(204, 204, 204)))
entwine_2 = Entwine(Branch00=range_2, Branch01=range, FlattenInputs=True)  # -> simplify(Result)
branch_2 = TreeBranch(Tree=entwine_2, Path=list_2, MaintainPaths=False)
windpredict = WindPredictor(
    Points=brep2grid.Points,
    Buildings=brep,
    ONNXPath=branch,
    U_ref=panel,
    Z_ref=10,
    Pedestrian_level=1.8,
    Wind_dir=branch_2,
    GPU=True,
    FilterMargin=100,
    Palette="jet",
    Interpolate=False)  # -> X, Y, WindSpeed, GridMesh, LegendMesh, LegendPoints, LegendValues
comfort_metric = ValueList({"Lawson General": 0, "Lawson LDDC": 1, "Lawson 2001": 2, "Davenport": 3, "NEN8100 Comfort": 4, "NEN8100 Safety": 5}, selected="NEN8100 Comfort")
pt = ConstructPoint(XCoordinate=windpredict.X, YCoordinate=windpredict.Y, ZCoordinate=1.8)

# ---- group: Create comfort map
safetytoggle = SafetyToggle()

# ----
path_4 = FilePath("C:\Users\ilker\Desktop\wind_study\epw_files\TUR_Istanbul.170600_IWEC.epw")
windcomfortml = WindComfortPredictorML(
    Points=pt,
    WindSpeeds=windpredict.WindSpeed,
    WindDirections=branch_2,
    EPWPath=path_4,
    Z_ref=10,
    Z_0=1,
    U_ref_sim=5,
    Metric=comfort_metric,
    Interpolate=True,
    Run=safetytoggle)  # -> ComfortRank, ClassLetter, Class, ComfortMesh, LegendMesh, LegendPoints, LegendLetters
mesh = Mesh(windcomfortml.ComfortMesh)
mesh_2 = Mesh(windcomfortml.LegendMesh)
tag = TextTag3D(
    Location=windcomfortml.LegendPoints,
    Text=windcomfortml.LegendLetters,
    Size=16,
    Colour=ColourSwatch(SwatchColor=RGB(255, 255, 255)),
    Justification=5)
