# Grasshopper definition SurfaceTemps_FFT.ghx (Grasshopper 1.0.8)
# plug-ins: Outdoor, Eddy3D-Radiance

number_slider = Slider(2, range=0..10)

# ---- group: Ground Surface
# Description: Outdoor surface temperatures for a full year from the frequency-domain admittance method of Beckett, Owens and Acred, with no thermal mesh and no warm-up. Brep Grid Points samples a ground Brep and ten context Breps every 2 m, Sky Exposure supplies sky view factors, and two SurfaceTemp components solve grass_ground and brick_wall constructions against an Istanbul file from Download Weather, with Indoor Temp 22 degC for walls. Deconstruct SurfaceTemp reduces each point's 8760-hour series to Mean, Min and Max; Bounds and Gradient turn the mean into point colors and rounded Text Tag labels. Replace the Breps, weather station and materials.
brep = Brep(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)

# ----
brepgrid = BrepGridPoints(Geometry=brep, Spacing=number_slider)  # -> Points, Vectors, Mesh, Status
context = Brep([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])
join = BrepJoin(Breps=context)  # -> Breps, Closed
preview = CustomPreview(Geometry=join.Breps, Material=ColourSwatch(SwatchColor=RGB(255, 255, 255)))
sky_exposure = SkyExposure(Positions=brepgrid.Points, Context=join.Breps, Offset=0.918)
brepgrid_2 = BrepGridPoints(Geometry=join.Breps, Spacing=number_slider)  # -> Points, Vectors, Mesh, Status

weather = DownloadWeather(Station="istanbul")  # -> EPWFile, Logs, Stations, Station, ExtraFiles, SiteLatitude, SiteLongitude

surfacetemp_material = SurfaceTempMaterial(MaterialList="brick_wall")
surfacetemp_material_2 = SurfaceTempMaterial(MaterialList="grass_ground")
surfacetemp = SurfaceTemp(
    Points=brepgrid.Points,
    Vectors=brepgrid.Vectors,
    EPW=weather.EPWFile,
    Material=surfacetemp_material_2,
    IndoorTemp=22,
    SkyView=sky_exposure,
    Run=True,
    SurfaceTempPersistResults=False)
surfacetemp_2 = SurfaceTemp(
    Points=brepgrid_2.Points,
    Vectors=brepgrid_2.Vectors,
    EPW=weather.EPWFile,
    Material=surfacetemp_material,
    IndoorTemp=22,
    SkyView=sky_exposure,
    Run=True,
    SurfaceTempPersistResults=False)
deconstruct_surfacetemp = DeconstructSurfaceTemp(Result=surfacetemp)  # -> Mean, Min, Max, SurfaceTemp
deconstruct_surfacetemp_2 = DeconstructSurfaceTemp(Result=surfacetemp_2)  # -> Mean, Min, Max, SurfaceTemp

# ---- group: Mean
bnd = Bounds(Numbers=deconstruct_surfacetemp.Mean)
dedomain = DeconstructDomain(Domain=bnd)  # -> Start, End
panel = Panel(deconstruct_surfacetemp.Mean)
gradient = Gradient(
    LowerLimit=dedomain.Start,
    UpperLimit=dedomain.End,
    Parameter=deconstruct_surfacetemp.Mean,
    stops=[0: RGB(48, 18, 59), 0.0294: RGB(56, 40, 112), 0.0588: RGB(63, 62, 156), 0.0882: RGB(68, 82, 193), 0.118: RGB(70, 102, 221), 0.147: RGB(71, 122, 241)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])
round = Round(Number=panel)  # -> Nearest, Floor, Ceiling
preview_2 = CustomPreview(Geometry=brepgrid.Points, Material=gradient)
tag = TextTag(Location=brepgrid.Points, Text=round.Nearest, Colour=ColourSwatch(SwatchColor=RGB(255, 255, 255)))

# ----
bnd_2 = Bounds(Numbers=deconstruct_surfacetemp_2.Mean)
dedomain_2 = DeconstructDomain(Domain=bnd_2)  # -> Start, End
panel_2 = Panel(deconstruct_surfacetemp_2.Mean)
gradient_2 = Gradient(
    LowerLimit=dedomain_2.Start,
    UpperLimit=dedomain_2.End,
    Parameter=deconstruct_surfacetemp_2.Mean,
    stops=[0: RGB(48, 18, 59), 0.0294: RGB(56, 40, 112), 0.0588: RGB(63, 62, 156), 0.0882: RGB(68, 82, 193), 0.118: RGB(70, 102, 221), 0.147: RGB(71, 122, 241)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])
round_2 = Round(Number=panel_2)  # -> Nearest, Floor, Ceiling
preview_3 = CustomPreview(Geometry=brepgrid_2.Points, Material=gradient_2)
tag_2 = TextTag(Location=brepgrid.Points, Text=round_2.Nearest, Colour=ColourSwatch(SwatchColor=RGB(255, 255, 255)))
