# Grasshopper definition CylinderDomain.ghx (Grasshopper 1.0.8)
# plug-ins: Outdoor, Eddy3D

# Description: Purpose: Pedestrian-level wind around an Atlanta site for every prevailing wind direction, solved on one mesh.
# Fidelity: Engineering - steady RANS, not validated for this site. Cite: Kastner and Dogan (2020), cylindrical mesh.
# Method: Steady RANS in OpenFOAM on a cylindrical mesh; Wind Rose Cluster reduces the EPW to up to 8 directions and speeds.
# Result: Velocity U probed 1.5 m above terrain, one direction per slider step.
# Needs: Eddy3D Setup > (U)RANS CFD (OpenFOAM). Runtime: hours.
# Edit: Station, site coordinates, buildings, tree zones; toggle Fetch for land cover and terrain.
# Related work to cite:
# 
# Kastner, P., & Dogan, T. (2020).
# A cylindrical meshing methodology
#  for annual urban computational fluid dynamics
# simulations. Journal of Building Performance Simulation, 13(1), 59-68.
# 
# Kastner, P., & Dogan, T. (2022).
# Eddy3D: A toolkit for decoupled
# outdoor thermal comfort simulations
# in urban areas. Building and Environment, 212, 108639.
download_weather = DownloadWeather(Station="Atlanta", ChartMonthFrom=1, ChartMonthTo=12)  # -> EPWFile, Logs, Stations, Station, ExtraFiles, SiteLatitude, SiteLongitude
deconstruct_weather = DeconstructWeather(
    Weather=download_weather.EPWFile,
    Series="""Dry Bulb Temperature
Relative Humidity
Wind Speed
Wind Direction
Solar Elevation
Solar Azimuth
Hour of Year
Latitude
Longitude""")  # -> DryBulbTemperature, RelativeHumidity, WindSpeed, WindDirection, SolarElevation, SolarAzimuth, HourOfYear, Latitude, Longitude
wind_rose_cluster = WindRoseCluster(
    Directions=deconstruct_weather.WindDirection,
    Budget="8",
    WindSpeeds=deconstruct_weather.WindSpeed,
    Series="""Wind Directions
Wind Speeds""")  # -> WindDirections, WindSpeeds
atmospheric_boundary_layer = AtmosphericBoundaryLayer(
    WindDirections=wind_rose_cluster.WindDirections,
    WindSpeed=wind_rose_cluster.WindSpeeds,
    ReferenceHeight=10,
    RoughnessLengthZ0=1,
    GroundHeight=0,
    TurbulentKEK=0.015,
    TurbulentEpsilonΕ=0.135,
    TurbulentOmegaΩ=100,
    TerrainType="Custom (z0 input)",
    InletProfile="Log law (Richards & Hoxey)",
    DisplacementHeight=0,
    AblOutputLayoutVersion=2)  # -> BoundaryConditions, WindVectors
run_settings = RunSettings(
    Iterations="200",
    WriteInterval=20,
    KeepTimeSteps=3,
    TurbulenceModel="realizableKE",
    CPUCount=-1,
    SolverAlgorithm="SIMPLE",
    AgeOfAir=False,
    Numerics="0,0.5,0.5",
    PotentialFoamInit=True,
    WarmUpIterations=-1,
    FieldMonitors=False,
    PedestrianAverage=False,
    PressureCoefficient=False,
    Convergence=0.0001,
    AutoStopOnPlateau=False,
    Duration=-1,
    TimeStep=-1,
    MaxCourant=-1,
    AveragingWindow=-1,
    PressureSolver="GAMG",
    LaplacianScheme="auto",
    MeshQualityPreset="auto",
    PedestrianHeight=1.75,
    Guideline="None",
    ConcurrentDirections=1,
    EmptyDomainCheck=False)  # -> RunSettings, DebugLogs
cylinder_domain = CylinderDomain(
    CoreCellSize=40,
    InnerCoreSize=-1,
    OuterRadius=-1,
    Height=-1,
    RadialMultiplier=2,
    CoreDivisions=1,
    RefinementBoxExtension=-1,
    RadialGrading=1,
    CoreRoundness=0.65,
    VerticalGrading=1)
land_cover_roughness = LandCoverRoughness(
    Latitude="33.78145186480617",
    Longitude="-84.37722219362138",
    Radius="700",
    TerrainRadius="700",
    Anchor=PlaneXY(0, 0, 0),
    RefinementLevel=2,
    ColorBy="Land use",
    Fetch=Toggle(True),
    LandZ0InputLayoutVersion=3)  # -> GroundZones, Boundaries, RoughnessLengths, LandCover, Terrain, SiteElevation, ColoredMesh
geometry = Geometry(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)
geometry_2 = Geometry(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)
geometry_3 = Geometry(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)
geometry_4 = Geometry([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])
tree = Tree(Geometry=geometry, Type="live oak")
tree_2 = Tree(Geometry=geometry_2, Type="dense")
tree_3 = Tree(Geometry=geometry_3, Type="silver birch")
curve = Curve(land_cover_roughness.Boundaries)
geometry_5 = Geometry(land_cover_roughness.Terrain)
outdoor_case = OutdoorCase(
    BoundaryConditions=atmospheric_boundary_layer.BoundaryConditions,
    DomainParameters=cylinder_domain,
    Buildings=geometry_4,
    Trees=[tree, tree_2, tree_3],
    Terrain=land_cover_roughness.Terrain,
    RunSettings=run_settings.RunSettings,
    GroundRoughness=land_cover_roughness.GroundZones,
    PedestrianSpacing="2",
    Engine="Containerized",
    Write=False,
    ClearCase=False,
    AutoName="merry-lemur-dune-quill",
    AutoWrapGeometry=False,
    ClayLook=True,
    OutdoorCaseInputLayoutVersion=7,
    PreviewBuildings=False,
    PreviewDimensions=True,
    PreviewGrid3D=True,
    PreviewGroundGrid=True,
    PreviewRefinementBox=True,
    PreviewWindArrows=True,
    RepairGeometry=True)  # -> Logs, WriteLogs, Case, Domain, RefinementBox, Buildings, PedestrianPoints, Terrain
meshing_progress = MeshingProgress(Case=outdoor_case.Case, Live=True)  # -> Progress, Phase, Done, Status
live_residuals = LiveResiduals(Case=outdoor_case.Case, Live=True, DirectionDegrees=-1, ShowResidualGoals=False)
plot_residuals = PlotResiduals(Case=outdoor_case.Case, Plot=False, ResidualViewerTarget=0)
parse_case_logs = ParseCaseLogs(Case=outdoor_case.Case, Run=True)  # -> LogSummary, Errors, Warnings
run = Run(
    Case=outdoor_case.Case,
    Mesh=False,
    CreateZones=False,
    Simulate=False,
    RunAll=False,
    Parallel=True,
    DirectionIndex=-1,
    ShowZones=True)
open_in_paraview = OpenInParaView(Case=outdoor_case.Case, Open=False, ComfortMetric=1, DirectionIndex=-1, ParaviewInputLayoutVersion=2, Streamlines=True)
panel = Panel(parse_case_logs.LogSummary)
probe = Probe(
    Case=outdoor_case.Case,
    Points=outdoor_case.PedestrianPoints,
    Field="U",
    Run=False,
    AutoProbeName="sunny-ferret-mesa-compass",
    BakeTimeHistory=False,
    CullHugeVectors=False,
    CullInvalid=False,
    OpenTerminal=True,
    ShowCulled=False)  # -> Values, TimeSteps, SubResults, Points
vector_field_viewer = VectorFieldViewer(
    Velocity=probe.Values,
    Points=probe.Points,
    DisplayMode="Vector Field",
    ColorMap="Viridis",
    Scale=1,
    VectorPlane="3D",
    ArrowheadScaling="Linear",
    SeedCount=120,
    VectorFieldViewerInputLayoutVersion=2)  # -> Geometry, Colors, Range
